# Grasshopper definition assignment-01.gh (Grasshopper 1.0.9)

# Assignment-01: Bauhaus
number_slider = Slider(2, range=1..4)
py3 = Python3Script(
    tower_count=number_slider,
    spacing_mult=Slider(1.25, range=1.05..10),
    bridge_z=Slider(10, range=0..100),
    cantilever_len=Slider(20, range=1..20),
    cylinder_radius=Slider(12.134, range=1..20),
    cylinder_z_center=Slider(11.186, range=0..20))  # -> out, towers, bridge, arch_void
# ---------- py3: Python ----------
import importlib

from cdf import geometry_basics

importlib.reload(geometry_basics)

composition = geometry_basics.build_composition(
    tower_count,
    spacing_mult,
    bridge_z,
    cantilever_len,
    cylinder_radius,
    cylinder_z_center,
)

towers = composition["towers"]
bridge = composition["bridge"]
arch_void = composition["arch_void"]
info = composition["info"]

print("Towers: {}  |  pitch: {:.2f}".format(len(towers), info["pitch"]))
print(
    "Constant tower volume: {:.1f}  (scale k = {:.3f})".format(
        info["effective_volume"], info["k"]
    )
)
print("Heights: " + ", ".join("{:.1f}".format(h) for h in info["heights"]))
print(
    "Bridge X: {:.1f} -> {:.1f}  |  top Z: {:.1f}".format(
        info["bridge_x0"], info["bridge_x1"], info["bridge_top"]
    )
)
print("Tallest tower pierces bridge by {:.1f}".format(info["pierce_amount"]))
# ---------- end py3 ----------
sunion = SolidUnion(Breps=flatten([py3.bridge, py3.towers]))
panel = Panel(py3.out)
sdiff = SolidDifference(BrepsA=sunion, BrepsB=py3.arch_void)
